# Grasshopper definition test.gh (Grasshopper 0.9.76)
# plug-ins: MeshEdit Components, Circulation

geo = Geometry(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)
pt = Point(Point(5.166913638, 9.66057667, 0))
geo_2 = Geometry([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])
pt_2 = Point(Point(23.94757727, 17.17619169, 0))
node = Node(Position=pt, Name=pt, Floor="FLOOR")
floor = Floor(Boundary=geo, Name="FLOOR")
barrier = Barrier(Boundary=geo_2, Floor="FLOOR")
node_2 = Node(Position=pt_2, Name=pt_2, Floor="FLOOR")
agent = Agent(Name=pt, Origin=pt, Destination=pt_2)
dup = DuplicateData(Data=agent, Number=Slider(10, range=0..10), Order=True)
env = Environment(Entities=[floor, node, agent, node_2, barrier, dup], Resolution=Slider(1, range=0..1), Run=Toggle(True))
bmap = BarrierMap(Environment=env, FloorName="FLOOR")  # -> Mesh, Values
apaths = AgentPaths(Environment=env, AgentName=pt)  # -> Mesh, Indexes, Log
facen = FaceNormals(Mesh=apaths.Mesh)  # -> Centers, Normals
number_slider = Slider(10, range=0..10)
item = ListItem(List=facen.Centers, Index=apaths.Indexes, Wrap=True)
dmap = DensityMap(Environment=env, FloorName="FLOOR")  # -> Mesh, Values
gradient = Gradient(
    LowerLimit=0,
    UpperLimit=1,
    Parameter=dmap.Values,
    stops=[0: RGB(234, 38, 0), 0.25: RGB(234, 126, 0), 0.5: RGB(254, 244, 84), 0.75: RGB(173, 203, 249), 1: RGB(75, 107, 169)])
explode = MeshExplode(Mesh=dmap.Mesh, Interpolate=False)
bnd = Bounds(Numbers=dmap.Values)
panel = Panel(bnd)
preview = CustomPreview(Geometry=explode, Shader=gradient)
